# Grasshopper definition 01 Program.ghx (Grasshopper 1.0.8)

base_width = Slider(6, range=1..20)

# ---- group: RH_OUT Width
width = Number(base_width)

# ----
project_label = GetString("Garden pavilion", AtLeast=1, AtMost=1, TreeAccess=False)
c_script = CSharpScript(width=base_width)  # -> samples, profiles; inputs width: Double
# ---------- c_script: C# ----------
// #! csharp
using Grasshopper;
using Grasshopper.Kernel.Data;

public class Script_Instance : GH_ScriptInstance
{
    private void RunScript(double width, ref object samples, ref object profiles)
    {
        samples = new double[] { width, width * 1.5, width * 2 };
        var tree = new DataTree<double>();
        tree.Add(width, new GH_Path(0, 1));
        tree.Add(width + 2, new GH_Path(0, 1));
        tree.Add(width + 5, new GH_Path(2, 4));
        profiles = tree;
    }
}
# ---------- end c_script ----------

# ---- group: RH_OUT Samples
samples = Number(c_script.samples)

# ---- group: RH_OUT Profiles
profiles = Number(c_script.profiles)

# ----
c_print = ContextPrint(Label=project_label)
c_script_2 = CSharpScript(width=base_width)  # -> model; inputs width: Double
# ---------- c_script_2: C# ----------
// #! csharp
using Rhino.Geometry;

public class Script_Instance : GH_ScriptInstance
{
    private void RunScript(double width, ref object model)
    {
        var size = System.Math.Max(0.1, width);
        model = new Box(Plane.WorldXY, new Interval(0, size),
            new Interval(0, 0.55 * size), new Interval(0, 1.4 * size)).ToBrep();
    }
}
# ---------- end c_script_2 ----------
