# Grasshopper definition 04 Assemble.ghx (Grasshopper 1.0.8)

width = GetNumber("4", AtLeast=1, AtMost=1, Maximum=1.797693135e+308, Minimum=-1.797693135e+308, TreeAccess=False)

# ---- group: RH_OUT Final width
final_width = Number(width)

# ----
label = GetString("Garden pavilion", AtLeast=1, AtMost=1, TreeAccess=False)
samples = GetNumber("4", AtLeast=1, AtMost=100, Maximum=1.797693135e+308, Minimum=-1.797693135e+308, TreeAccess=False)
profiles = GetNumber("3", AtLeast=1, AtMost=100, Maximum=1.797693135e+308, Minimum=-1.797693135e+308, TreeAccess=True)
c_print = ContextPrint(FinalLabel=label)
c_script = CSharpScript(width=width)  # -> model; inputs width: Double
# ---------- c_script: C# ----------
// #! csharp
using Rhino.Geometry;

public class Script_Instance : GH_ScriptInstance
{
    private void RunScript(double width, ref object model)
    {
        var size = System.Math.Max(0.1, width);
        model = new Box(Plane.WorldXY, new Interval(0, size),
            new Interval(0, 0.55 * size), new Interval(0, 1.4 * size)).ToBrep();
    }
}
# ---------- end c_script ----------
